# Grasshopper definition GH SCRIPTS.gh (Grasshopper 1.0.7)
# plug-ins: Rhino.Inside for Autodesk Revit, TT Toolbox

# ----
# SELECT ELEMENTS FROM REVIT
# MANUAL OR BY CATEGORY
built_in_categories = BuiltInCategories("autodesk.revit.category.local:walls-1.0.0", LayoutLevel=2)
category_filter = CategoryFilter(Categories=built_in_categories, Inverted=False)
query_elements = QueryElements(Filter=category_filter, Limit=100)  # -> Elements, Count

# ----
# PASTE IN IDS
# HIT PLAY TO ADD TO CURRENT REVIT SELECTION
panel = Panel("""6265352
5398956""")
trigger = Trigger(Interval=-1000, TimerInterval=1000, Target=select_element)
query_element = QueryElement(Id=panel)
select_element = SelectElement(Element=query_element, Selected=Toggle(True))  # -> Element, Selected

# ----
# CHOOSE PARAMETERS TO EXTRACT
element_passport = ElementPassport(Element=graft(query_elements.Elements))  # -> DocumentGUID, Document, UniqueID, simplify(Id)
list_item = ListItem(List=query_elements.Elements, Index=0, Wrap=True)
query_element_parameters = QueryElementParameters(Element=list_item)  # -> simplify(Parameters)
value_picker = ValuePicker(query_element_parameters)
data_dam = DataDam(DataA=value_picker, BufferDelay=10000000, BufferMode=0)
element_parameter = ElementParameter(Element=graft(query_elements.Elements), Parameter=data_dam)  # -> Element, Parameter, simplify(Value)
merge = Merge(Data1=element_passport.Id, Data2=element_parameter.Value)
merge_2 = Merge(Data1="Id", Data2=data_dam)

write_options = WriteOptions(ClearDataOverwrite=True, SaveAfterWrite=False, CloseAfterWrite=False, ColumnStartPosition=1, RowStartPosition=1)  # -> UserMessages, WriteOptions
# WRITE TO EXCEL
boolean_toggle = BooleanToggle(False)
write_to_excel = WriteToExcel(
    Run=boolean_toggle,
    ExcelWorksheet="1",
    ColumnNames=merge_2,
    WriteOptions=write_options.WriteOptions,
    ColumnnsOrRows=True,
    DataToWriteIntoColumns=merge)
